# Grasshopper definition queen_movement_ex6.gh (Grasshopper 1.0.7)
# plug-ins: Firefly.Core

# ----
# communicating with Arduino
# via serail port
# Check the BAUDRATE
ports_available = COMPortsAvailable()
panel = Panel(ports_available)
toggle = BooleanToggle(True)
timer = Timer(TimerInterval=200, Target=read)
select_the_right_port = ListItem(List=panel, Index=2, Wrap=True)
panel_2 = Panel(select_the_right_port)
open_port = OpenClosePort(OpenClosePort=toggle, PortNumber=panel_2, BaudRate=9600)
panel_3 = Panel(open_port)
read = SerialReadGeneric(StartReadingValues=toggle, PortNumber=panel_2)  # -> SerialOutput, StatusMessage

vec = VectorXYZ(XComponent="0", YComponent=read.SerialOutput, ZComponent="0")  # -> Vector, Length
white_queen = Brep(<brep referenced from the Rhino model>)
panel_4 = Panel(vec.Vector)
move_to_e6 = Move(Geometry=white_queen, Motion=vec.Vector)  # -> Geometry, Transform
